# Grasshopper definition balloon+unordered_points.gh (Grasshopper 1.0.7)
# plug-ins: Weaverbird, Kangaroo2 Components

# ----
# Variable
cell_size = Slider(15, range=0..20)
threshold = Slider(8, range=0..10)
threshold_2 = Data(threshold)
cell_size_2 = Data(cell_size)

# ---- group: Bygningsmesh
mesh = Mesh([<mesh referenced from the Rhino model> x96])

# ----
# Extreme points
weaverbird_s_join_meshes_and_weld = WeaverbirdsJoinMeshesAndWeld(Mesh=mesh, Weld=False)
bounding_box = BoundingBox(Content=weaverbird_s_join_meshes_and_weld, Plane=PlaneXY(0, 0, 0))  # -> Box, Box_2
deconstruct_box = DeconstructBox(Box=bounding_box.Box)  # -> Plane, X, Y, Z
deconstruct_domain = DeconstructDomain(Domain=deconstruct_box.X)  # -> Start, End
deconstruct_domain_2 = DeconstructDomain(Domain=deconstruct_box.Y)  # -> Start, End
min_x = Number(deconstruct_domain.Start)
max_x = Number(deconstruct_domain.End)
min_y = Number(deconstruct_domain_2.Start)
max_y = Number(deconstruct_domain_2.End)

# ----
# Point Grid
min_x_2 = Number(min_x)
min_y_2 = Number(min_y)
max_x_2 = Number(max_x)
max_y_2 = Number(max_y)
cell_size_3 = Number(cell_size_2)
pt = ConstructPoint(XCoordinate=min_x_2, YCoordinate=min_y_2, ZCoordinate=0)
vec = VectorXYZ(XComponent=cell_size_3, YComponent=cell_size_3, ZComponent=0)  # -> Vector, Length
rev = Reverse(Vector=vec.Vector)
subtraction = Subtraction(A=max_x_2, B=min_x_2)
subtraction_2 = Subtraction(A=max_y_2, B=min_y_2)
move = Move(Geometry=pt, Motion=rev)  # -> Geometry, Transform
division = Division(A=subtraction, B=cell_size_3)
division_2 = Division(A=subtraction_2, B=cell_size_3)
round = Round(Number=division)  # -> Nearest, Floor, Ceiling
round_2 = Round(Number=division_2)  # -> Nearest, Floor, Ceiling
addition = Addition(A=round.Ceiling, B="2")
addition_2 = Addition(A=round_2.Ceiling, B="2")
sqgrid = Square(Plane=move.Geometry, Size=cell_size_3, ExtentX=addition, ExtentY=addition_2)  # -> Cells, Points
num = Number(addition)
num_2 = Number(addition_2)
point_grid = Point(flatten(sqgrid.Points))
item = TreeItem(Tree=simplify(sqgrid.Points), Path=graft(["0", num]), Index=["0", num_2], Wrap=True)
corners = Point(flatten(item))

# ----
# Cull points closer than threshold to walls
point_grid_2 = Point(point_grid)
floor_plan = Curve(mesh)
pull = PullPoint(Point=point_grid_2, Geometry=simplify(mesh), ClosestOnly=True)  # -> ClosestPoint, Distance
flip = FlipMatrix(Data=pull.Distance)
sort = SortList(Keys=flip)  # -> Keys, ValuesA
item_2 = ListItem(List=sort.Keys, Index=0, Wrap=True)  # -> flatten(Item)
threshold_3 = Data(threshold_2)
larger = LargerThan(FirstNumber=item_2, SecondNumber=threshold_3)  # -> LargerThan, OrEqualTo
cull = CullPattern(List=point_grid_2, CullPattern=larger.LargerThan)
modified_point_grid = Point(cull)

threshold_4 = Data()
wbicosahedron = WeaverbirdsMeshMeshIcosahedron(Plane=modified_point_grid, Radius=1.5)
wbloop = WeaverbirdsLoopSubdivision(MeshCurves=wbicosahedron, Level=2, SmoothNakedEdges=1)  # disabled
modified_point_grid_2 = Point(modified_point_grid)

# ---- group: collision between ballons
crossref = CrossReference(ListA=flatten(wbloop), ListB=flatten(wbloop), CrossMode=5)  # -> ListA, ListB
demesh = DeconstructMesh(Mesh=crossref.ListB)  # -> Vertices, Faces, Colours, Normals
spc = SolidPointCollide(Points=demesh.Vertices, Solid=graft(crossref.ListA), Interior=False, Unidirectional=False, Strength=1000)

# ---- group: keep balloons in box
demesh_2 = DeconstructMesh(Mesh=wbloop)  # -> Vertices, Faces, Colours, Normals
spc_2 = SolidPointCollide(
    Points=demesh_2.Vertices,
    Solid=weaverbird_s_join_meshes_and_weld,
    Interior=True,
    Unidirectional=True,
    Strength=Slider(100, range=1..1000))

# ----
edgelengths = EdgeLengths(Mesh=wbloop, LengthFactor=Slider(2, range=0..4), Strength=Slider(7, range=1..15))
pressure = Pressure(M=wbloop, Strength=Slider(1.27, range=0..2))
show = Show(G=wbloop)
button = Button()
entwine = Entwine(Branch00=[edgelengths, spc_2, pressure, spc], Branch01=show, FlattenInputs=True)
solver = Solver(GoalObjects=entwine, Reset=button, Threshold=1e-07, Tolerance=0.01, On=Toggle(False))  # -> I, V, O
bouncysolver = BouncySolver(
    GoalObjects=entwine,
    Reset=button,
    Threshold=1e-15,
    Tolerance=0.01,
    Damping=Slider(0.07, range=0.0001..1),
    Iterations=10,
    On=Toggle(False))  # -> I, V, O
mesh_2 = Mesh(bouncysolver.O)
bang = ExplodeTree(Data=solver.O)  # -> Branch0, Branch1
wbloop_2 = WeaverbirdsLoopSubdivision(MeshCurves=bang.Branch1, Level=1, SmoothNakedEdges=1)
colourful = Colourful(geo=wbloop_2)

# ==== cluster Colourful: Display objects in bright colours
geo = ClusterInput()
geo_2 = Geometry(geo)
clean = CleanTree(RemoveNulls=True, RemoveInvalid=True, RemoveEmpty=False, Tree=flatten(geo_2))
S = Shader([{diffuse=RGB(11, 125, 222), emission=RGB(3, 38, 67), shine=0.5, specular=RGB(255, 255, 255), transparency=0}, {diffuse=RGB(222, 37, 11), emission=RGB(67, 11, 3), shine=0.5, specular=RGB(255, 255, 255), transparency=0}, {diffuse=RGB(71, 222, 11), emission=RGB(21, 67, 3), shine=0.5, specular=RGB(255, 255, 255), transparency=0}, {diffuse=RGB(222, 194, 11), emission=RGB(67, 58, 3), shine=0.5, specular=RGB(255, 255, 255), transparency=0}])
lng = ListLength(List=clean)
repeat = RepeatData(Data=S, Length=lng)
preview = CustomPreview(Geometry=clean, Shader=repeat)
