# Grasshopper definition gbXML_export.gh (Grasshopper 1.0.7)

current_directory = GhPythonScript()  # -> dir
# ---------- current_directory: Python ----------
import Grasshopper
path = Grasshopper.Instances.ActiveCanvas.Document.FilePath
dir = "\\".join(path.split("\\")[:-1])+"\\"
# ---------- end current_directory ----------
concat = Concatenate(FragmentA=current_directory, FragmentB="gbXML_export.xml")
concat_2 = Concatenate(FragmentA=current_directory, FragmentB="gbXML_export.py")
file = ReadFile(File=concat_2, PerLineParse=False)
brep = Brep([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])
gbxml = GhPythonScript(Code=file, Rooms=brep, Path=concat)
