# Grasshopper definition room_connectivity.gh (Grasshopper 1.0.7)

sample_distance = Slider(1000, range=200..5000)
path = FilePath("C:\Users\sdmei\git\space-invader\components\room_connectivity.py")
file = ReadFile(File=path, PerLineParse=False)
srf = Surface([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])

# ----
# Room tags
area = Area(Geometry=srf)  # -> Area, Centroid
lng = ListLength(List=area.Centroid)
series = Series(Start=0, Step=1, Count=lng)
tag = TextTag(Location=area.Centroid, Text=series)

connectivity = GhPythonScript(Code=file, Rooms=srf, Distance=Slider(706, range=0..1000), Sample=sample_distance)
panel = Panel(connectivity)
