# Grasshopper definition rays+regions.gh (Grasshopper 1.0.7)

# Number of Rays
number_of_rays = Slider(8, range=0..100)
niklas_perfekte_model = Curve([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])
anders_fejlmodel = Curve([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])
# Building Mesh
crv = Curve(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)
# Ray-wall distance threshold
number_slider = Slider(250, range=100..500)
# Room height
number_slider_2 = Slider(3000, range=1000..5000)
# Point Grid Cell Size
number_slider_3 = Slider(1000, range=100..5000)
wall_lines = Curve(anders_fejlmodel)
wall_lines_2 = Curve(wall_lines)

# ----
# Extrude
room_surfaces = Surface()
room_height = Number(number_slider_2)
Z = UnitZ(Factor=room_height)
boundary = BoundarySurfaces(Edges=room_surfaces)
extr = Extrude(Base=boundary, Direction=Z)

# ----
# Clean up
# Simplify and extend
crv_2 = Curve(reparameterize(wall_lines_2))
toggle = BooleanToggle(False)
toggle_2 = BooleanToggle(True)
redpline = Reduce(Polyline=crv_2, Tolerance=0.1)  # -> Polyline, Reduction
duplcrvs = RemoveDuplicateCurves(C=redpline.Polyline, plusFlipped=toggle, onlyOverlapped=toggle_2)  # -> readMe, UC, DC, DI; inputs C: list of Curve, plusFlipped: Boolean, onlyOverlapped: Boolean
# ---------- duplcrvs: Python ----------
#********************************************************************************************#
#********* Select duplicate curves **********************************************************#
#********* by Djordje Spasic ****************************************************************#
#********* issworld2000@yahoo.com 16-May-2014 ***********************************************#

"""
Removes all duplicate curves, whether they're positioned on top of each other or scattered around.
Supports any kind of curves (lines, polyline, rectangles, circles, arcs, freeform curves, helix... ).
Supports both lists and datatrees as inputs - and removes different types of curve duplicates from 
the same list or branch:

    Input:
        C: The curves you wish to "clean" from duplicates
        tol: Tolerances. If not supplied, Rhino's Model absolute tolerances will be used
        plusFlipped: This will clean the curves of the same shape, but flipped
        onlyOverlapped: Only equal curves positioned on top of each other will be considered, not those scattered around
    Output:
        readMe!: ...
        UC: Unique curves
        DC: Duplicate curves
        DI: Duplicate indices
"""

ghenv.Component.Name = "Remove duplicate curves"
ghenv.Component.NickName = "duplCrvs"
ghenv.Component.Category = "Milkbox"
ghenv.Component.SubCategory = "Curves"
try: ghenv.Component.AdditionalHelpFromDocStrings = "1"
except: pass

import scriptcontext as sc
import Rhino

def cullDuplicateCurves(_crvs, _t, _tol, _flippedCrvs, _overlapped):
    duplCrvs = []
    nc_objs = [crv.ToNurbsCurve() for crv in _crvs]
    indx = []
    for i in range(len(nc_objs)):
        for k in range(len(nc_objs)):
            if (i != k) and (i not in indx) and (k not in indx) and (round(nc_objs[i].GetLength(), 3) == round(nc_objs[k].GetLength(), 3)):
                    if nc_objs[i].EpsilonEquals(nc_objs[k], _t):
                        crv1TVst = nc_objs[i].TangentAt(nc_objs[i].Domain[0])
                        crv1CVst = nc_objs[i].CurvatureAt(nc_objs[i].Domain[0])
                        crv1t1 = round( nc_objs[i].NormalizedLengthParameter( 0.33, Rhino.Geometry.Interval(0, nc_objs[i].GetLength()) )[1], 3 )
                        crv1CVmid1 = nc_objs[i].CurvatureAt(crv1t1)
                        crv1t2 = round( nc_objs[i].NormalizedLengthParameter( 0.66, Rhino.Geometry.Interval(0, nc_objs[i].GetLength()) )[1], 3 )
                        crv1CVmid2 = nc_objs[i].CurvatureAt(crv1t2)
                        crv1CVend = nc_objs[i].CurvatureAt(nc_objs[i].Domain[1])
                        crv1TVend = nc_objs[i].TangentAt(nc_objs[i].Domain[1])

                        crv2TVst = nc_objs[k].TangentAt(nc_objs[k].Domain[0])
                        crv2CVst = nc_objs[k].CurvatureAt(nc_objs[k].Domain[0])
                        crv2t1 = round( nc_objs[k].NormalizedLengthParameter( 0.33, Rhino.Geometry.Interval(0, nc_objs[k].GetLength()) )[1], 3 )
                        crv2CVmid1 = nc_objs[i].CurvatureAt(crv2t1)
                        crv2t2 = round( nc_objs[k].NormalizedLengthParameter( 0.66, Rhino.Geometry.Interval(0, nc_objs[k].GetLength()) )[1], 3 )
                        crv2CVmid2 = nc_objs[i].CurvatureAt(crv2t2)
                        crv2CVend = nc_objs[k].CurvatureAt(nc_objs[k].Domain[1])
                        crv2TVend = nc_objs[k].TangentAt(nc_objs[k].Domain[1])

                        if _flippedCrvs == False and _overlapped == False:
                            if ( crv1TVst.EpsilonEquals(crv2TVst, _tol) and crv1CVst.EpsilonEquals(crv2CVst, _tol) and crv1CVmid1.EpsilonEquals(crv2CVmid1, _tol) and crv1CVmid2.EpsilonEquals(crv2CVmid2, _tol) and crv1CVend.EpsilonEquals(crv2CVend, _tol) and crv1TVend.EpsilonEquals(crv2TVend, _tol) ):
                                indx.append(i)
                        elif _flippedCrvs == True and _overlapped == False:
                            crv2TVstR = Rhino.Geometry.Vector3d(crv2TVst)
                            crv2TVstR.Reverse()
                            crv2TVendR = Rhino.Geometry.Vector3d(crv2TVend)
                            crv2TVendR.Reverse()
    
                            crv2R = nc_objs[k].Duplicate()
                            crv2R.Reverse()
                            crv2TVstRR = crv2R.TangentAt(crv2R.Domain[0])
                            crv2CVstR = crv2R.CurvatureAt(crv2R.Domain[0])
                            crv2t1R = round( crv2R.NormalizedLengthParameter( 0.33, Rhino.Geometry.Interval(0, crv2R.GetLength()) )[1], 3 )
                            crv2CVmid1R = crv2R.CurvatureAt(crv2t1R)
                            crv2t2R = round( crv2R.NormalizedLengthParameter( 0.66, Rhino.Geometry.Interval(0, crv2R.GetLength()) )[1], 3 )
                            crv2CVmid2R = crv2R.CurvatureAt(crv2t2R)
                            crv2CVendR = crv2R.CurvatureAt(crv2R.Domain[1])
                            crv2TVendRR = crv2R.TangentAt(crv2R.Domain[1])
                            if ( crv1TVst.EpsilonEquals(crv2TVst, _tol) and crv1CVst.EpsilonEquals(crv2CVst, _tol) and crv1CVmid1.EpsilonEquals(crv2CVmid1, _tol) and crv1CVmid2.EpsilonEquals(crv2CVmid2, _tol) and crv1CVend.EpsilonEquals(crv2CVend, _tol) and crv1TVend.EpsilonEquals(crv2TVend, _tol) )\
                            or ( crv1TVst.EpsilonEquals(crv2TVendR, _tol) and crv1CVst.EpsilonEquals(crv2CVend, _tol) and crv1CVmid1.EpsilonEquals(crv2CVmid2, _tol) and crv1CVmid2.EpsilonEquals(crv2CVmid1, _tol) and crv1CVend.EpsilonEquals(crv2CVst, _tol) and crv1TVend.EpsilonEquals(crv2TVstR, _tol) )\
                            or ( crv1TVst.EpsilonEquals(crv2TVstRR, _tol) and crv1CVst.EpsilonEquals(crv2CVstR, _tol) and crv1CVmid1.EpsilonEquals(crv2CVmid1R, _tol) and crv1CVmid2.EpsilonEquals(crv2CVmid2R, _tol) and crv1CVend.EpsilonEquals(crv2CVendR, _tol) and crv1TVend.EpsilonEquals(crv2TVendRR, _tol) ):
                                indx.append(i)
                        elif _flippedCrvs == False and _overlapped == True:
                            t1 = (nc_objs[i].Domain[0]+nc_objs[i].Domain[1])/2
                            midCrv1 = nc_objs[i].PointAt(t1)
                            t2 = (nc_objs[k].Domain[0]+nc_objs[k].Domain[1])/2
                            midCrv2 = nc_objs[k].PointAt(t2)
                            if ( midCrv1.EpsilonEquals(midCrv2, _tol) and crv1TVst.EpsilonEquals(crv2TVst, _tol) and crv1CVst.EpsilonEquals(crv2CVst, _t) and crv1CVmid1.EpsilonEquals(crv2CVmid1, _tol) and crv1CVmid2.EpsilonEquals(crv2CVmid2, _tol) and crv1CVend.EpsilonEquals(crv2CVend, _tol) and crv1TVend.EpsilonEquals(crv2TVend, _tol) ):
                                indx.append(i)
                        elif _flippedCrvs == True and _overlapped == True:
                            crv2TVstR = Rhino.Geometry.Vector3d(crv2TVst)
                            crv2TVstR.Reverse()
                            crv2TVendR = Rhino.Geometry.Vector3d(crv2TVend)
                            crv2TVendR.Reverse()
    
                            crv2R = nc_objs[k].Duplicate()
                            crv2R.Reverse()
                            crv2TVstRR = crv2R.TangentAt(crv2R.Domain[0])
                            crv2CVstR = crv2R.CurvatureAt(crv2R.Domain[0])
                            crv2t1R = round( crv2R.NormalizedLengthParameter( 0.33, Rhino.Geometry.Interval(0, crv2R.GetLength()) )[1], 3 )
                            crv2CVmid1R = crv2R.CurvatureAt(crv2t1R)
                            crv2t2R = round( crv2R.NormalizedLengthParameter( 0.66, Rhino.Geometry.Interval(0, crv2R.GetLength()) )[1], 3 )
                            crv2CVmid2R = crv2R.CurvatureAt(crv2t2R)
                            crv2CVendR = crv2R.CurvatureAt(crv2R.Domain[1])
                            crv2TVendRR = crv2R.TangentAt(crv2R.Domain[1])

                            t1 = (nc_objs[i].Domain[0]+nc_objs[i].Domain[1])/2
                            midCrv1 = nc_objs[i].PointAt(t1)
                            t2 = (nc_objs[k].Domain[0]+nc_objs[k].Domain[1])/2
                            midCrv2 = nc_objs[k].PointAt(t2)
                            if ( midCrv1.EpsilonEquals(midCrv2, _tol) and crv1TVst.EpsilonEquals(crv2TVst, _tol) and crv1CVst.EpsilonEquals(crv2CVst, _t) and crv1CVmid1.EpsilonEquals(crv2CVmid1, _tol) and crv1CVmid2.EpsilonEquals(crv2CVmid2, _tol) and crv1CVend.EpsilonEquals(crv2CVend, _tol) and crv1TVend.EpsilonEquals(crv2TVend, _tol) )\
                            or ( midCrv1.EpsilonEquals(midCrv2, _tol) and crv1TVst.EpsilonEquals(crv2TVendR, _tol) and crv1CVst.EpsilonEquals(crv2CVend, _tol) and crv1CVmid1.EpsilonEquals(crv2CVmid2, _tol) and crv1CVmid2.EpsilonEquals(crv2CVmid1, _tol) and crv1CVend.EpsilonEquals(crv2CVst, _tol) and crv1TVend.EpsilonEquals(crv2TVstR, _tol) )\
                            or ( midCrv1.EpsilonEquals(midCrv2, _tol) and crv1TVst.EpsilonEquals(crv2TVstRR, _tol) and crv1CVst.EpsilonEquals(crv2CVstR, _tol) and crv1CVmid1.EpsilonEquals(crv2CVmid1R, _tol) and crv1CVmid2.EpsilonEquals(crv2CVmid2R, _tol) and crv1CVend.EpsilonEquals(crv2CVendR, _tol) and crv1TVend.EpsilonEquals(crv2TVendRR, _tol) ):
                                indx.append(i)
    crvsIndexes = range(len(_crvs))
    uniqCrvs = []
    for index in indx:
        duplCrvs.append(_crvs[index])
    for index2 in crvsIndexes:
        if index2 not in indx:
            uniqCrvs.append(_crvs[index2])

    if len(indx) > 0:
        print "Found %s duplicate curves" % len(indx)
        return [duplCrvs, indx, uniqCrvs]
    else:
        print "No duplicate curves found"
        return [[], [], C]

if not tol:
    tol = Rhino.RhinoDoc.ActiveDoc.ModelAbsoluteTolerance
if not plusFlipped:
    plusFlipped = True
if not onlyOverlapped:
    onlyOverlapped = False

if C:
    if len(C)>1:
        t = 100000000
        a = cullDuplicateCurves(C, t, tol, plusFlipped, onlyOverlapped)
        UC = a[2]
        DC = a[0]
        DI = a[1]
    else:
        UC = []
        DC = []
        DI = []
        print "ONLY ONE CURVE HAS BEEN INPUTTED."
else:
    print "INPUT PARAMETER \"C\" FAILED TO COLLECT CURVE DATA !!!"
# ---------- end duplcrvs ----------
redpline_2 = Reduce(Polyline=duplcrvs.UC, Tolerance=0.1)  # -> Polyline, Reduction
crv_3 = Curve(redpline_2.Polyline)

# ----
# Find Closest points
# that are not endpoints and are within the distance limit
crv_4 = Curve(crv_3)
end = EndPoints(Curve=crv_4)  # -> Start, End
crv_cp = CurveClosestPoint(Point=simplify(graft([end.Start, end.End])), Curve=reparameterize(crv_4))  # -> Point, Parameter, Distance
smaller = SmallerThan(FirstNumber=crv_cp.Distance, SecondNumber=Slider(200, range=0..1000))  # -> SmallerThan, OrEqualTo
smaller_2 = SmallerThan(FirstNumber=crv_cp.Parameter, SecondNumber="1e-3")  # -> SmallerThan, OrEqualTo
larger = LargerThan(FirstNumber=crv_cp.Parameter, SecondNumber="1-1e-3")  # -> LargerThan, OrEqualTo
or = GateOr(A=larger.LargerThan, B=smaller_2.SmallerThan)
not = GateNot(A=or)
parameters = Number(simplify(crv_cp.Parameter))
and = GateAnd(A=not, B=smaller.SmallerThan)  # -> simplify(Result)
path_mapper = PathMapper(and, source="{A}(B)", target="{B}(A)")
path_mapper_2 = PathMapper(parameters, source="{A}(B)", target="{B}(A)")
cull = CullPattern(List=simplify(path_mapper_2), CullPattern=simplify(path_mapper))
any = AnyTrue_2(values=path_mapper)  # -> flatten(any_true)
not_2 = GateNot(A=any)
shatter = Shatter(Curve=graft(crv_4), Parameters=cull)
cull_2 = CullPattern(List=simplify(crv_4), CullPattern=not_2)
shattered_curves = Curve(shatter)
curves_to_keep = Curve(cull_2)
merge = Merge(Data1=flatten(shattered_curves), Data2=flatten(curves_to_keep))  # -> flatten(Result)
crv_5 = Curve(merge)

# ----
# Extend lines
crv_6 = Curve(crv_5)
distance_threshold = Number(Slider(400, range=0..1000))
python = GhPythonScript(C=crv_6, t=distance_threshold)  # -> out, C, obstacles; inputs C: tree of Curve
# ---------- python: Python ----------
"""
Inputs:
    C   Wall curves
    t   Distance threshold
Outputs:
    C  Wall curves
"""
import rhinoscriptsyntax as rs
import Rhino.Geometry as rg
import ghpythonlib.components as gh
import ghpythonlib.treehelpers as ght
from Grasshopper import DataTree
from Grasshopper.Kernel.Data import GH_Path

EPS = 1e-1


def extend_to_collision(curve, obstacles):
    extensions = []
    if curve.IsPolyline():
        #Start point ray
        pnt0 = curve.PointAtStart
        tan0 = curve.TangentAtStart
        tan0.Reverse()
        ray0 = rg.Line(pnt0, tan0, 1)
        _, dist0, i0 = gh.IsoVistRay(ray0, t, obstacles)
        if i0 != -1:
#            print(pnt0, tan0, ray0, dist0)
            extensions.append(rg.LineCurve(rg.Line(pnt0, tan0, dist0)))
        
        #End Point ray
        pnt1 = curve.PointAtEnd
        tan1 = curve.TangentAtEnd
        ray1 = rg.Line(pnt1, tan1, 1)
        _, dist1, i1 = gh.IsoVistRay(ray1, t, obstacles)
        if i1 != -1:
            print(pnt1, tan1, ray1, dist1)
            print(obstacles)
            extensions.append(rg.LineCurve(rg.Line(pnt1, tan1, dist1)))

    return extensions




def clean_obstacles(curve, other_curves):
    oc = []
    for other_curve in other_curves:
        distances = [gh.Distance(curve.PointAtStart, other_curve.PointAtStart),
                     gh.Distance(curve.PointAtStart, other_curve.PointAtEnd),
                     gh.Distance(curve.PointAtEnd, other_curve.PointAtStart),
                     gh.Distance(curve.PointAtEnd, other_curve.PointAtEnd)]
        close = [True if d<=EPS else False for d in distances]
        if not any(close):
            oc.append(other_curve)
    return oc

C.Flatten()
curves = ght.tree_to_list(C)
all_extensions = []
for i, curve in enumerate(curves):
    obstacles = clean_obstacles(curve, curves)
    print(i, len(obstacles),"/",len(curves))
    curve_extensions = extend_to_collision(curve, obstacles)
    all_extensions.extend(curve_extensions)
curves.extend(all_extensions)

C = ght.list_to_tree(curves)
# ---------- end python ----------
crv_7 = Curve(python.C)

# ----
# Simplify
crv_8 = Curve(crv_7)
redpline_3 = Reduce(Polyline=crv_8, Tolerance=0.1)  # -> Polyline, Reduction
explode = Explode(Curve=redpline_3.Polyline, Recursive=True)  # -> flatten(Segments), Vertices
crv_9 = Curve(explode.Segments)

duplcrvs_2 = RemoveDuplicateCurves(C=crv_9, plusFlipped=toggle, onlyOverlapped=toggle_2)  # -> readMe, UC, DC, DI; inputs C: list of Curve, plusFlipped: Boolean, onlyOverlapped: Boolean; same code as duplcrvs
wall_lines_3 = Curve(duplcrvs_2.UC)
wall_lines_4 = Curve(wall_lines_3)

# ----
# Extreme points
bbox = BoundingBox(Content=wall_lines_4, Plane=PlaneXY(0, 0, 0), UnionBox=True)  # -> Box, Box_2
box = EvaluateBox(Box=bbox.Box, UParameter=1, VParameter=1, WParameter=1)  # -> Plane, Point, Include
debox = DeconstructBox(Box=bbox.Box)  # -> Plane, X, Y, Z
dedomain = DeconstructDomain(Domain=debox.X)  # -> Start, End
dedomain_2 = DeconstructDomain(Domain=debox.Y)  # -> Start, End
dedomain_3 = DeconstructDomain(Domain=debox.Z)  # -> Start, End
vlen = VectorLength(Vector=box.Point)
min_x = Number(dedomain.Start)
max_x = Number(dedomain.End)
min_y = Number(dedomain_2.Start)
max_y = Number(dedomain_2.End)
min_z = Number(dedomain_3.Start)
max_z = Number(dedomain_3.End)
longest_distance = Number(vlen)

# ----
# Point Grid
max_y_2 = Number(max_y)
min_y_2 = Number(min_y)
max_x_2 = Number(max_x)
min_x_2 = Number(min_x)
cell_size = Number(number_slider_3)
subtraction = Subtraction(A=min_y_2, B=cell_size)
subtraction_2 = Subtraction(A=min_x_2, B=cell_size)
subtraction_3 = Subtraction(A=max_x_2, B=min_x_2)
subtraction_4 = Subtraction(A=max_y_2, B=min_y_2)
xy = XYPlane(Origin=Point(0, 0, 0))
pt = ConstructPoint(XCoordinate=subtraction_2, YCoordinate=subtraction, ZCoordinate=0)
division = Division(A=subtraction_3, B=cell_size)
division_2 = Division(A=subtraction_4, B=cell_size)
round = Round(Number=division)  # -> Nearest, Floor, Ceiling
round_2 = Round(Number=division_2)  # -> Nearest, Floor, Ceiling
pl_origin = PlaneOrigin(Base=xy, Origin=pt)
addition = Addition(A=round.Ceiling, B=1)
addition_2 = Addition(A=round_2.Ceiling, B=1)
sqgrid = Square(Plane=pl_origin, Size=cell_size, ExtentX=addition, ExtentY=addition_2)  # -> Cells, Points
point_grid = Point(flatten(sqgrid.Points))

# ----
# Frasorterer punkter for tæt på vægge
distance_threshold_2 = Number(number_slider)
point_grid_2 = Point(point_grid)
wall_lines_5 = Line(wall_lines_3)
crv_cp_2 = CurveClosestPoint(Point=point_grid_2, Curve=graft(wall_lines_5))  # -> Point, Parameter, Distance
flip = FlipMatrix(Data=crv_cp_2.Distance)
sort = SortList(Keys=flip)  # -> Keys, ValuesA
item = ListItem(List=sort.Keys, Index=0, Wrap=True)  # -> flatten(Item)
larger_2 = LargerThan(FirstNumber=item, SecondNumber=distance_threshold_2)  # -> LargerThan, OrEqualTo
cull_3 = CullPattern(List=point_grid_2, CullPattern=larger_2.LargerThan)
cull_pattern = Boolean(larger_2.LargerThan)
point_grid_3 = Point(cull_3)

# ----
# Isovist
wall_lines_6 = Line(flatten(wall_lines_3))
number_of_rays_2 = Number(number_of_rays)
point_grid_4 = Point(point_grid_3)
ray_radius = Number(longest_distance)
ivist = IsoVist(Plane=simplify(point_grid_4), Count=number_of_rays_2, Radius=ray_radius, Obstacles=wall_lines_6)  # -> Points, Distance, Index
hit_wall_indices = Number(ivist.Index)
hit_distances = Number(ivist.Distance)
hit_points = Point(ivist.Points)

# ----
# Datasortering og rensning af "cullede" lister
# Cull pattern: Any ray in list has not hit an object
hit_points_2 = Point(hit_points)
hit_wall_indices_2 = Number(hit_wall_indices)
equals = Equality(FirstNumber=hit_wall_indices_2, SecondNumber="-1")  # -> Equality, Inequality
any_2 = AnyTrue(list_of_bools=equals.Equality)
not_3 = GateNot(A=any_2)
cull_4 = CullPattern(List=hit_points_2, CullPattern=not_3)  # -> simplify(List)
clean = CleanTree(RemoveNulls=True, RemoveInvalid=True, RemoveEmpty=True, Tree=cull_4)
python_2 = GhPythonScript(L=clean)  # -> L; inputs L: tree
# ---------- python_2: Python ----------
L.RenumberPaths()
# ---------- end python_2 ----------
pt_2 = Point(python_2)

pline = PolyLine(Vertices=pt_2, Closed=True)
boundary_2 = BoundarySurfaces(Edges=pline)

# ==== cluster AnyTrue: Returns true for a list if any value in the list is true
list_of_bools = ClusterInput()
ma = MassAddition(Input=list_of_bools)  # -> Result, PartialResults
equals = Equality(FirstNumber=ma.Result, SecondNumber=Slider(0, range=0..100))  # -> Equality, Inequality
result = ClusterOutput(equals.Inequality)

# ==== cluster AnyTrue_2: Returns True if any input value is True
values = ClusterInput()
ma = MassAddition(Input=values)  # -> Result, PartialResults
larger = LargerThan(FirstNumber=ma.Result, SecondNumber=Slider(1, range=0..1))  # -> LargerThan, simplify(OrEqualTo)
any_true = ClusterOutput(larger.OrEqualTo)
